# Grasshopper definition 001_Eulers_totient_function.gh (Grasshopper 1.0.7)
# plug-ins: RhinoCodePluginGH

# gpt-4 Transcript link:
# 
# https://chat.openai.com/share/a2a19f95-d527-4a35-84db-c444f21d8b6f
number_slider = Slider(46, range=0..100)

# ----
# BASIC SCRIPT
# PARAMETRIC SCRIPT PROMPT
# 
# Make this parametric and suggest the inputs
# and list the input data types.
# gpt-4 Advanced Response
# 2nd gpt-4 Text Prompt
# To further extend the complexity and
# functionality, you could consider adding more
# parameters to manipulate the ellipsoid, visualize
#  the geometrical data, and perhaps incorporate
# other geometrical entities. You can include color
#  mapping based on point coordinates, generate
# vectors representing the axes, and perhaps
# introduce some interaction with other
# geometrical entities. Below is an extended
# version of the Python script using Numpy for a
# more complex and enriched 3D model:
# Great, now make the script much more complex model
# with NUMPY python library.
# Be sure to incorporate the previous code logic.
# ensure that this script produces 3d geometry as
# well for Data visualization purposes.
# ADVANCED SCRIPT
number_slider_2 = Slider(20, range=0..100)  # disabled
number_slider_3 = Slider(0, range=0..10)  # disabled
number_slider_4 = Slider(0, range=0..10)  # disabled
number_slider_5 = Slider(5.08, range=0..10)  # disabled
number_slider_6 = Slider(8.75, range=0..10)  # disabled
# Visualize Mathematics
# with Python in Grasshopper
# at Wickerson Studios
# Part 4: Algebra and Arithmetic
# 4.7 COMMON FUNCTIONS
# 004_007_004_Ellipse
# gpt-4 Initial Response
# gpt-4 Text Prompt
# Alright, to avoid transformation errors, let’s try
# constructing a parametric ellipsoid from scratch
# by generating points and creating a surface
# through those points. We can follow the
# parametric equations for an ellipsoid:
# Create a geometric 3D model with
# 
# MATHEMATICS
# AREA, VOULUME AND SURFACE AREA
# 
# to create a 3D model specifically about
# 
# Common Functions: Ellipse
# ((x-h)^2)/a^2 + ((y-k)^2)/b^2 = 1
# 
# 
# in python 3 code for the python 3 script
# node in grasshopper for Rhino8WIP using the
# Rhino Common API to create some geometry as well.
# 
# Output the parts of the model in different
# variable outputs in the python 3 node in
# grasshopper.
number_slider_7 = Slider(0, range=0..10)  # disabled
number_slider_8 = Slider(6.78, range=0..10)  # disabled
ellipse_function = Script(
    x=number_slider_7,
    y=number_slider_3,
    z=number_slider_4,
    a=number_slider_5,
    b=number_slider_8,
    c=number_slider_6,
    u_count=number_slider_2,
    v_count=number_slider_2)  # -> out, A; inputs x: Double, y: Double, z: Double, a: Double, b: Double, c: Double, u_count: Int32, v_count: Int32; disabled
# ---------- ellipse_function: Python ----------
import Rhino.Geometry as rg
import math

# Parameters
h = x  # x-coordinate of the center of the ellipsoid
k = y  # y-coordinate of the center of the ellipsoid
l = z  # z-coordinate of the center of the ellipsoid
a = a  # Semi-major axis in the x-direction
b = b  # Semi-major axis in the y-direction
c = c  # Semi-major axis in the z-direction
u_count = 20  # Number of divisions in the u direction
v_count = 20  # Number of divisions in the v direction

# Validate the semi-major axes
if a <= 0 or b <= 0 or c <= 0:
    raise ValueError("Semi-major axes must be positive non-zero values")

def create_ellipsoid(h, k, l, a, b, c, u_count, v_count):
    points = []
    for i in range(u_count + 1):
        row = []
        u = -math.pi / 2 + i * math.pi / u_count  # u parameter ranges from -π/2 to π/2
        for j in range(v_count + 1):
            v = j * 2 * math.pi / v_count  # v parameter ranges from 0 to 2π
            x = h + a * math.cos(u) * math.cos(v)
            y = k + b * math.cos(u) * math.sin(v)
            z = l + c * math.sin(u)
            point = rg.Point3d(x, y, z)
            row.append(point)
        points.append(row)
    
    # Create surfaces from points
    surfaces = []
    for i in range(u_count):
        for j in range(v_count):
            p1 = points[i][j]
            p2 = points[i][j + 1]
            p3 = points[i + 1][j + 1]
            p4 = points[i + 1][j]
            surface = rg.NurbsSurface.CreateFromCorners(p1, p2, p3, p4)
            if surface: surfaces.append(surface)
    
    return surfaces


# Outputs
A = create_ellipsoid(h, k, l, a, b, c, u_count, v_count)  # Output the ellipsoid geometry as a list of surfaces
# ---------- end ellipse_function ----------
ellipse_function_2 = Script(
    x=Slider(0, range=0..10),
    y=Slider(0, range=0..10),
    z=Slider(1.79, range=0..10),
    a=Slider(4.04, range=0..10),
    b=Slider(3.7, range=0..10),
    c=Slider(8.73, range=0..10),
    u_count=Slider(43, range=0..100),
    v_count=number_slider)  # -> out, A, B, C; inputs x: Double, y: Double, z: Double, a: Double, b: Double, c: Double, u_count: Int32, v_count: Int32
# ---------- ellipse_function_2: Python ----------
import Rhino.Geometry as rg
import System.Drawing as drawing  # Corrected import statement
import math
import numpy as np

# Parameters
h = x  # x-coordinate of the center of the ellipsoid
k = y  # y-coordinate of the center of the ellipsoid
l = z  # z-coordinate of the center of the ellipsoid
a = a  # Semi-major axis in the x-direction
b = b  # Semi-major axis in the y-direction
c = c  # Semi-major axis in the z-direction
#u_count = 30  # Number of divisions in the u direction
#v_count = 30  # Number of divisions in the v direction

# Validate the semi-major axes
if a <= 0 or b <= 0 or c <= 0:
    raise ValueError("Semi-major axes must be positive non-zero values")

def map_to_color(value, min_val, max_val):
    """ Map a value to a color """
    col_range = 255.0
    norm_value = (value - min_val) / (max_val - min_val)
    return drawing.Color.FromArgb(int(norm_value * col_range), 0, int((1.0 - norm_value) * col_range))  # Corrected usage

def create_complex_ellipsoid(h, k, l, a, b, c, u_count, v_count):
    u = np.linspace(-math.pi / 2, math.pi / 2, u_count + 1)
    v = np.linspace(0, 2 * math.pi, v_count + 1)
    u, v = np.meshgrid(u, v, indexing='ij')
    
    x = h + a * np.cos(u) * np.cos(v)
    y = k + b * np.cos(u) * np.sin(v)
    z = l + c * np.sin(u)
    
    max_distance = math.sqrt(a**2 + b**2 + c**2)
    color_data = np.sqrt((x-h)**2 + (y-k)**2 + (z-l)**2)
    
    # Create surfaces and color them based on distance from center
    surfaces = []
    colors = []
    for i in range(u_count):
        for j in range(v_count):
            p1 = rg.Point3d(x[i, j], y[i, j], z[i, j])
            p2 = rg.Point3d(x[i, j + 1], y[i, j + 1], z[i, j + 1])
            p3 = rg.Point3d(x[i + 1, j + 1], y[i + 1, j + 1], z[i + 1, j + 1])
            p4 = rg.Point3d(x[i + 1, j], y[i + 1, j], z[i + 1, j])
            surface = rg.NurbsSurface.CreateFromCorners(p1, p2, p3, p4)
            if surface:
                surfaces.append(surface)
                colors.append(map_to_color(color_data[i, j], 0, max_distance))
    
    # Draw semi-major axes vectors
    axes = []
    axes.append(rg.Line(rg.Point3d(h, k, l), rg.Point3d(h + a, k, l))) # x-axis
    axes.append(rg.Line(rg.Point3d(h, k, l), rg.Point3d(h, k + b, l))) # y-axis
    axes.append(rg.Line(rg.Point3d(h, k, l), rg.Point3d(h, k, l + c))) # z-axis
    
    return surfaces, colors, axes


# Outputs
A, B, C = create_complex_ellipsoid(h, k, l, a, b, c, u_count, v_count)  # Output surfaces, their colors, and the axes
# ---------- end ellipse_function_2 ----------
panel = Panel(ellipse_function.out)  # disabled
geometry = Geometry(ellipse_function.A)  # disabled
panel_2 = Panel(ellipse_function_2.out)
geometry_2 = Geometry(ellipse_function_2.A)
geometry_3 = Geometry(ellipse_function_2.C)
entwine = Entwine(Branch00=geometry, FlattenInputs=True)  # disabled
entwine_2 = Entwine(Branch00=geometry_2, Branch01=ellipse_function_2.B, Branch02=geometry_3, FlattenInputs=True)
# Visualize Mathematics
# with C# in Grasshopper
# at Wickerson Studios
# Part 4: Algebra and Arithmetic
# 4.7 COMMON FUNCTIONS
# 004_007_001_Constant Function
# gpt-4 Text Prompt
# Use this script editor template to create a script
#  for the C# node in grasshopper for rhino8 that
# models geometry for the
# 
# ALGEBRA AND ARITHMETIC
# 
# and specifically the
# 
# 
# Common Functions: llipse
# ((x-h)^2)/a^2 + ((y-k)^2)/b^2 = 1
# 
# 
# 
# 
# //Grasshopper Script Instance
# //#! csharp
# using System;
# using System.Collections;
# using System.Collections.Generic;
# using System.Drawing;
# 
# using Rhino;
# using Rhino.Geometry;
# 
# using Grasshopper;
# using Grasshopper.Kernel;
# using Grasshopper.Kernel.Data;
# using Grasshopper.Kernel.Types;
# 
# public class Script_Instance : GH_ScriptInstance
# {
#   /*
#     Members:
#       RhinoDoc RhinoDocument
#       GH_Document GrasshopperDocument
#       IGH_Component Component
#       int Iteration
# 
#     Methods (Virtual & overridable):
#       Print(string text)
#       Print(string format, params object[] args)
#       Reflect(object obj)
#       Reflect(object obj, string method_name)
#   */
# 
#   private void RunScript(object x, object y, out object a)
#   {
#     // Write your logic here
#     a = null;
#   }
# }
panel_3 = Panel(entwine)  # disabled
# 2nd gpt-4 Text Prompt
# Great, now make the script much more complex model
# with C# script and Rhino common API.
# 
# Be sure to incorporate the previous code logic.
# ensure that this script produces 3d geometry as
# well for Data visualization purposes.
panel_4 = Panel(entwine_2)

mesh_colours = MeshColours(Mesh=graft(geometry_2), Colours=graft(ellipse_function_2.B))
# gpt-4 Transcript link:
# 
# https://chat.openai.com/share/49eec364-c718-4b62-8c55-571b3f495127
number_slider_9 = Slider(6, range=0..10)

# ----
# BASIC SCRIPT
# ADVANCED  SCRIPT
number_slider_10 = Slider(0, range=0..10)
# gpt-4 Initial Response
# Absolutely, you can extend the script to create
# more complex 3D geometry based on the
# original Ellipse for data visualization purposes.
# Below is an example of an extended C# script
# which creates a 3D Ellipsoid at the given center
# h, k, l with the semi-axes a, b, c. The ellipsoid will
# be created around the ellipse by revolution and
# will be segmented by planes to visualize internal
# data.
number_slider_11 = Slider(0, range=0..10)
# gpt-4 Initial Response
# To create an ellipse, you can use the following
# script. This script will accept two points (h,k) as
# the center of the ellipse, and two values a and b
# as the semi-major and semi-minor axes of the
# ellipse respectively, and will then create an
# ellipse curve in Rhino/Grasshopper.
number_slider_12 = Slider(4.33, range=0..10)
ellipse_function_3 = Script(
    h=number_slider_11,
    k=number_slider_10,
    l=Slider(0, range=0..10),
    a=Slider(7.22, range=0..10),
    b=Slider(2.87, range=0..10),
    c=Slider(6.24, range=0..10),
    segments=number_slider_9)  # -> out, Ellipsoid, SectionCurves; inputs h: Double, k: Double, l: Double, a: Double, b: Double, c: Double, segments: Int32
# ---------- ellipse_function_3: C# ----------
//Grasshopper Script Instance
//#! csharp
using System;
using System.Collections;
using System.Collections.Generic;
using System.Drawing;

using Rhino;
using Rhino.Geometry;

using Grasshopper;
using Grasshopper.Kernel;
using Grasshopper.Kernel.Data;
using Grasshopper.Kernel.Types;

// Grasshopper Script Instance
//#! csharp
using System;
using System.Collections.Generic;
using Rhino.Geometry;

public class Script_Instance : GH_ScriptInstance
{
  private void RunScript(double h, double k, double l, double a, double b, double c, int segments, out object Ellipsoid, out object SectionCurves)
  {
    Brep ellipsoid = null;
    List<Curve> sectionCurves = new List<Curve>();
    
    // Initial assignments to avoid compile errors
    Ellipsoid = null; 
    SectionCurves = sectionCurves;
    
    if (a <= 0 || b <= 0 || c <= 0)
    {
      Print("Semi-major axis (a), semi-minor axis (b), and height (c) should be greater than 0");
      return;
    }
    
    Point3d center = new Point3d(h, k, l);
    Plane basePlane = new Plane(center, Vector3d.ZAxis);
    Ellipse baseEllipse = new Ellipse(basePlane, a, b);
    
    Curve ellipseCurve = baseEllipse.ToNurbsCurve();
    
    // Creating a Surface from the ellipse curve
    Surface surface = Surface.CreateExtrusion(ellipseCurve, new Vector3d(0, 0, c));
    if (surface != null)
    {
      // Scaling the surface in the z direction to create a 3D Ellipsoid
      Transform scaleTransform = Transform.Scale(Plane.WorldXY, 1, 1, c / a); // Assuming 'a' is the major radius
      surface.Transform(scaleTransform);
      
      ellipsoid = surface.ToBrep();
      
      double angleStep = 360.0 / segments;
      for (int i = 0; i < segments; i++)
      {
        double angle = i * angleStep;
        Vector3d normal = new Vector3d(Math.Cos(angle * Math.PI / 180.0), Math.Sin(angle * Math.PI / 180.0), 0);
        Plane sectionPlane = new Plane(center, normal);
        
        Curve[] intersectionCurves;
        Point3d[] intersectionPoints;
        
        if (Rhino.Geometry.Intersect.Intersection.BrepPlane(ellipsoid, sectionPlane, 0.001, out intersectionCurves, out intersectionPoints))
        {
          if (intersectionCurves != null)
            sectionCurves.AddRange(intersectionCurves);
        }
      }
    }
    
    Ellipsoid = ellipsoid; // Update the Ellipsoid output with the created ellipsoid
    SectionCurves = sectionCurves; // Update the SectionCurves output with the created section curves
  }
}
# ---------- end ellipse_function_3 ----------
ellipse_function_4 = Script(h=number_slider_12, k=Slider(3.04, range=0..10), a=Slider(2.53, range=0..10), b=Slider(1.65, range=0..10))  # -> out, Ellipse; inputs h: Double, k: Double, a: Double, b: Double
# ---------- ellipse_function_4: C# ----------
// Grasshopper Script Instance
//#! csharp
using System;
using System.Collections;
using System.Collections.Generic;
using System.Drawing;

using Rhino;
using Rhino.Geometry;

using Grasshopper;
using Grasshopper.Kernel;
using Grasshopper.Kernel.Data;
using Grasshopper.Kernel.Types;

// Grasshopper Script Instance
//#! csharp
using System;
using System.Collections.Generic;
using Rhino.Geometry;
using Grasshopper.Kernel;

public class Script_Instance : GH_ScriptInstance
{
  
  private void RunScript(double h, double k, double a, double b, out object Ellipse)
  {
    Ellipse = null; // Initialize to null
    
    if (a <= 0 || b <= 0) // a and b should be greater than 0
    {
      Print("Semi-major axis (a) and semi-minor axis (b) should be greater than 0");
      return;
    }
    
    // Center of the ellipse
    Point3d center = new Point3d(h, k, 0);
    
    // Constructing the ellipse
    Plane plane = Plane.WorldXY;
    plane.Origin = center;
    Ellipse ellipse = new Ellipse(plane, a, b);
    
    // Set the output
    Ellipse = ellipse.ToNurbsCurve();
  }
}
# ---------- end ellipse_function_4 ----------
geometry_4 = Geometry(ellipse_function_4.Ellipse)
panel_5 = Panel(ellipse_function_4.out)
geometry_5 = Geometry(ellipse_function_3.Ellipsoid)
geometry_6 = Geometry(ellipse_function_3.SectionCurves)
panel_6 = Panel(ellipse_function_3.out)
entwine_3 = Entwine(Branch00=geometry_4, FlattenInputs=True)
entwine_4 = Entwine(Branch00=geometry_5, Branch01=geometry_6, FlattenInputs=True)
panel_7 = Panel(entwine_3)
panel_8 = Panel(entwine_4)
