# Grasshopper definition 003_Law_of_Large_Numbers.gh (Grasshopper 1.0.7)
# plug-ins: RhinoCodePluginGH

# ----
# BASIC SCRIPT
# 2nd gpt-4 Text Prompt
# gpt-4 Advanced Response
# Great, now make the script much more complex model
# with NUMPY python library.
# Be sure to incorporate the previous code logic.
# ensure that this script produces 3d geometry as
# well for Data visualization purposes.
# To further extend the complexity and
# functionality, you could consider adding more
# parameters to manipulate the ellipsoid, visualize
#  the geometrical data, and perhaps incorporate
# other geometrical entities. You can include color
#  mapping based on point coordinates, generate
# vectors representing the axes, and perhaps
# introduce some interaction with other
# geometrical entities. Below is an extended
# version of the Python script using Numpy for a
# more complex and enriched 3D model:
# ADVANCED SCRIPT
# gpt-4 Transcript link:
# 
# https://chat.openai.com/share/aafd82a3-a326-4683-b656-7fc77bb8139a
number_slider = Slider(8, range=0..100)  # disabled
number_slider_2 = Slider(2, range=0..10)  # disabled
number_slider_3 = Slider(4.34, range=0..10)  # disabled
# Create a geometric 3D model with
# 
# MATHEMATICS
# 
# to create a 3D model specifically about
# 
# The fourth maxwell equation is the
# generalization of Ampère’s circuital law and can
#  be written both in differential and integral forms.
# 
# 
# in python 3 code for the python 3 script
# node in grasshopper for Rhino8WIP using the
# Rhino Common API to create some geometry as well.
# 
# Output the parts of the model in different
# variable outputs in the python 3 node in
# grasshopper.
# PARAMETRIC SCRIPT PROMPT
# 
# Make this parametric and suggest the inputs
# and list the input data types.
number_slider_4 = Slider(1.73, range=0..10)  # disabled
# Visualize Mathematics
# with Python in Grasshopper
# at Wickerson Studios
# Part 1: Mathtype
# 002 Ampere-Maxwell Equation
# gpt-4 Text Prompt
# gpt-4 Initial Response
# To create a 3D model based on the fourth
# Maxwell's equation using Python in a
# Grasshopper for Rhino8WIP, you'll be using the
# RhinoCommon API to generate geometry.
# 
# The fourth Maxwell's equation is the Ampère's
# Law with Maxwell’s Addition:
# 
# ∇×B-c1∂t∂E=μ0J
# 
# Here is an illustrative Python example on how to
#  visualize the magnetic field lines that could be
# represented by this law, which can be adapted
# to your needs:
# 
# This code doesn't exactly calculate the magnetic
#  or electric fields based on Maxwell's Equations
#  but is more illustrative of how to use
# RhinoCommon API with Python in Grasshopper.
construct_point = ConstructPoint(XCoordinate=0, YCoordinate=0, ZCoordinate=0)  # disabled
fourth_maxwell_equation = Script(
    center_pt=construct_point,
    radius=number_slider_4,
    num_turns=number_slider_2,
    field_line_length=number_slider_3,
    num_lines=number_slider)  # -> out, A, B; inputs center_pt: Point3d, radius: Double, num_turns: Int32, field_line_length: Double, num_lines: Int32; disabled
# ---------- fourth_maxwell_equation: Python ----------
import Rhino.Geometry as rg
import math

# Parameters (Grasshopper Inputs)
# center_pt: Point3d, Center of the coil
# radius: float, Radius of the coil
# num_turns: int, Number of turns in the coil
# field_line_length: float, Length of the field lines
# num_lines: int, Number of field lines

def create_coil(center, radius, num_turns):
    """
    Create a 3D coil representing the magnetic field source.
    """
    coil = []
    for i in range(num_turns):
        z = i * (2 * radius / num_turns)
        circle = rg.Circle(center + rg.Vector3d(0, 0, z), radius)
        coil.append(circle.ToNurbsCurve())
    return coil

def create_field_lines(center, radius, num_lines, length):
    """
    Create field lines representing the magnetic field.
    """
    field_lines = []
    angle = 0
    d_angle = 2 * math.pi / num_lines
    for i in range(num_lines):
        line_start = rg.Point3d(center.X + radius * math.cos(angle), center.Y + radius * math.sin(angle), center.Z)
        line_end = line_start + rg.Vector3d(0, 0, length)
        field_lines.append(rg.Line(line_start, line_end).ToNurbsCurve())
        angle += d_angle
    return field_lines

# Create coil and field lines
coil = create_coil(center_pt, radius, num_turns)
field_lines = create_field_lines(center_pt, radius, num_lines, field_line_length)

# Output the components
A = coil  # Output the coil curves
B = field_lines  # Output the field lines
# ---------- end fourth_maxwell_equation ----------
geometry = Geometry(fourth_maxwell_equation.B)  # disabled
geometry_2 = Geometry(fourth_maxwell_equation.A)  # disabled
panel = Panel(fourth_maxwell_equation.out)  # disabled
entwine = Entwine(Branch00=geometry_2, Branch01=geometry, FlattenInputs=True)  # disabled
# Visualize Mathematics
# with C# in Grasshopper
# at Wickerson Studios
# Part 1: Mathtype
# 002 Ampere-Maxwell Equation
# gpt-4 Text Prompt
# Use this script editor template to create a script
#  for the C# node in grasshopper for rhino8 that
# models geometry for the
# 
# MATHEMATICS
# 
# and specifically the
# 
# 
# The fourth maxwell equation is the
# generalization of Ampère’s circuital law and can
#  be written both in differential and integral forms.
# 
# 
# 
# //Grasshopper Script Instance
# //#! csharp
# using System;
# using System.Collections;
# using System.Collections.Generic;
# using System.Drawing;
# 
# using Rhino;
# using Rhino.Geometry;
# 
# using Grasshopper;
# using Grasshopper.Kernel;
# using Grasshopper.Kernel.Data;
# using Grasshopper.Kernel.Types;
# 
# public class Script_Instance : GH_ScriptInstance
# {
#   /*
#     Members:
#       RhinoDoc RhinoDocument
#       GH_Document GrasshopperDocument
#       IGH_Component Component
#       int Iteration
# 
#     Methods (Virtual & overridable):
#       Print(string text)
#       Print(string format, params object[] args)
#       Reflect(object obj)
#       Reflect(object obj, string method_name)
#   */
# 
#   private void RunScript(object x, object y, out object a)
#   {
#     // Write your logic here
#     a = null;
#   }
# }
panel_2 = Panel(entwine)  # disabled

# ----
# gpt-4 Initial Response
# When modeling something like the fourth
# Maxwell's equation (Ampère's circuital law), it is
# crucial to have a clear idea of what geometric
# representation or visualization you intend to
# create. This law can be represented with the
# equation:
# 
# ∇×B-c1∂t∂E=μ0J
# 
# Where:
# 
# ∇×B is the curl of the magnetic field
# ∂t/∂E  is the time derivative of the electric field
# μ0  is the permeability of free space.
# J is the current density.
# c is the speed of light.
# Let's make a simple example where we represent the magnetic field
# B and the electric field
# E as vectors in the 3D space, and we calculate
# the curl and time derivative to visualize the
# equation's components. This is purely an
# illustrative example and does not model physical
#  reality:
# BASIC SCRIPT
# Let's make a simple example where we
# represent the magnetic field
# B and the electric field
# E as vectors in the 3D space, and we calculate
# the curl and time derivative to visualize the
# equation's components. This is purely an
# illustrative example and does not model physical
# reality:
# 2nd gpt-4 Text Prompt
# Great, now make the script much more complex model
# with C# script and Rhino common API.
# 
# Be sure to incorporate the previous code logic.
# ensure that this script produces 3d geometry as
# well for Data visualization purposes.
# gpt-4 Transcript link:
# 
# https://chat.openai.com/share/2d693594-da10-4841-86e1-93b5570b6ad2
number_slider_5 = Slider(1, range=0..1)
# gpt-4 Initial Response
# Absolutely, you can extend the script to create
# more complex 3D geometry based on the
# original Ellipse for data visualization purposes.
# Below is an example of an extended C# script
# which creates a 3D Ellipsoid at the given center
# h, k, l with the semi-axes a, b, c. The ellipsoid will
# be created around the ellipse by revolution and
# will be segmented by planes to visualize internal
# data.
# ADVANCED  SCRIPT
number_slider_6 = Slider(2, range=0..10)
vector_xyz = VectorXYZ(XComponent=number_slider_5, YComponent=0, ZComponent=0)  # -> Vector, Length
vector_xyz_2 = VectorXYZ(XComponent=number_slider_5, YComponent=number_slider_5, ZComponent=0)  # -> Vector, Length
fourth_maxwell_equation_2 = Script(B=vector_xyz.Vector, E=vector_xyz_2.Vector, t=number_slider_6)  # -> out, CurlB, dEdt; inputs B: Vector3d, E: Vector3d, t: Double
# ---------- fourth_maxwell_equation_2: C# ----------
//Grasshopper Script Instance
//#! csharp
using System;
using System.Collections;
using System.Collections.Generic;
using System.Drawing;

using Rhino;
using Rhino.Geometry;

using Grasshopper;
using Grasshopper.Kernel;
using Grasshopper.Kernel.Data;
using Grasshopper.Kernel.Types;

using System;
using System.Collections.Generic;
using Rhino.Geometry;
using Grasshopper.Kernel;

public class MaxwellEquation : GH_ScriptInstance
{
  public override void InvokeRunScript(IGH_Component component, object x, int iteration, List<object> inputs, IGH_DataAccess DA)
  {
    // Define input parameters
    Vector3d B = new Vector3d();
    Vector3d E = new Vector3d();
    double t = 0.0;
    
    // Try to retrieve the inputs
    if (!DA.GetData(0, ref B)) return;
    if (!DA.GetData(1, ref E)) return;
    if (!DA.GetData(2, ref t)) return;
    
    // Call the RunScript method with the input parameters
    RunScript(B, E, t, out var CurlB, out var dEdt);
    
    // Set the output parameters
    DA.SetData(0, CurlB);
    DA.SetData(1, dEdt);
  }
  
  private void RunScript(Rhino.Geometry.Vector3d B, Rhino.Geometry.Vector3d E, double t, out object CurlB, out object dEdt)
  {
    // Calculate the curl of B (magnetic field)
    Vector3d curlB = new Vector3d(B.Y, -B.X, 0); // This is a simplification
    
    // Calculate the time derivative of E (electric field)
    Vector3d dedt = E * t; // This is also a simplification
    
    // Assign the results to the output parameters
    CurlB = curlB;
    dEdt = dedt;
  }
  
  // <Custom additional code> 
}
# ---------- end fourth_maxwell_equation_2 ----------
construct_point_2 = ConstructPoint(XCoordinate=0, YCoordinate=0, ZCoordinate=0)
vector = Vector(fourth_maxwell_equation_2.dEdt)
panel_3 = Panel(fourth_maxwell_equation_2.out)
vector_2 = Vector(fourth_maxwell_equation_2.CurlB)
entwine_2 = Entwine(Branch00=vector_2, Branch01=vector, FlattenInputs=True)
vector_display = VectorDisplay(Anchor=construct_point_2, Vector=[vector_2, vector_xyz.Vector])
vector_display_2 = VectorDisplay(Anchor=construct_point_2, Vector=[vector, vector_xyz_2.Vector])
panel_4 = Panel(entwine_2)
